vi "DetermineHighScore.gvi"   [LabVIEW NXG 2.0.0]
inputs:
  "Current High Score": f64
  "New Score": f64
outputs:
  "New High Score": f64
diagram:
  Is Less Than 0(x=$"Current High Score") -> w1
  Max And Min(x=$"New Score", y=$"Current High Score") -> (min(x,y)=w2: f64)
  Select(s=w1, t=$"New Score", f=w2) -> w3
  $"New High Score" <- w3
