vi "Snake Head Get.gvi"   [LabVIEW NXG 2.1.0]
inputs:
  "game state in": "Game State.gtype"
  "entity index": i32
outputs:
  "snake head": "Snake Head.gtype"
types:
  "Direction.gtype" = enum{"⬆️", "↗️", "➡️", "↘️", "⬇️", "↙️", "⬅️", "↖️"}
  "Edible.gtype" = bool
  "Snake Body.gtype" = bool
  "Entity.gtype" = cluster{"Direction": "Direction.gtype"[], "Edible": "Edible.gtype"[], "Position": "Position.gtype"[], "Snake Body": "Snake Body.gtype"[], "Snake Head": "Snake Head.gtype"[]}
  "Game State.gtype" = cluster{"World Size": cluster{"Width": u32, "Height": u32}, "Entities": "Entity.gtype"[]}
  "Snake Head.gtype" = cluster{"Snake Body Entities Index": u32[]}
diagram:
  Property Node(instance in=$"game state in") -> ("Entities"=w1)
  Array Index(array=w1) -> (out0[$"entity index"]=w2)
  Property Node(instance in=w2) -> ("Snake Head"=w3)
  Array Index(array=w3) -> (out0[_]=w4)
  $"snake head" <- w4
