vi "Grow Snake Body.gvi"   [LabVIEW NXG 2.1.0]
inputs:
  "game state in": "Game State.gtype"
  "Number of Body Segments": i32
  "Position": "Position.gtype"
outputs:
  "game state out": "Game State.gtype"
types:
  "Position.gtype" = cluster{"X": i32, "Y": i32}
  "Direction.gtype" = enum{"⬆️", "↗️", "➡️", "↘️", "⬇️", "↙️", "⬅️", "↖️"}
  "Edible.gtype" = bool
  "Snake Body.gtype" = bool
  "Entity.gtype" = cluster{"Direction": "Direction.gtype"[], "Edible": "Edible.gtype"[], "Position": "Position.gtype"[], "Snake Body": "Snake Body.gtype"[], "Snake Head": "Snake Head.gtype"[]}
  "Game State.gtype" = cluster{"World Size": cluster{"Width": u32, "Height": u32}, "Entities": "Entity.gtype"[]}
uses:
  WebVIArcade::Snake::SubVIs::Snake Head Index.gvi
diagram:
  call "Snake Head Index.gvi"()
  Property Node(instance in=$"game state in") -> ("Entities"=w1)
  Array Size(array=w1) -> (size(s)=w2)
  Build Array($Position) -> w3
  # TODO
  # update the snake head to have new body pieces appended
  for (N = $"Number of Body Segments") (iteration -> i1) {
    Property Node(instance in="Entity.gtype" {all zero or empty}, "Snake Body"=[TRUE], "Position"=w3) -> (instance out=w5)
    Add(w2, i1)
    append w5 to w4
  }
  Build Array(w1, w4)
