vi "Initialization System.gvi"   [LabVIEW NXG 2.1.0]
outputs:
  "game state out": "Game State.gtype"
types:
  "Direction.gtype" = enum{"⬆️", "↗️", "➡️", "↘️", "⬇️", "↙️", "⬅️", "↖️"}
  "Edible.gtype" = bool
  "Snake Body.gtype" = bool
  "Entity.gtype" = cluster{"Direction": "Direction.gtype"[], "Edible": "Edible.gtype"[], "Position": "Position.gtype"[], "Snake Body": "Snake Body.gtype"[], "Snake Head": "Snake Head.gtype"[]}
  "Game State.gtype" = cluster{"World Size": cluster{"Width": u32, "Height": u32}, "Entities": "Entity.gtype"[]}
  "Position.gtype" = cluster{"X": i32, "Y": i32}
  "Snake Head.gtype" = cluster{"Snake Body Entities Index": u32[]}
diagram:
  Property Node(instance in="Position.gtype" {all zero or empty}, "X"=500, "Y"=500) -> (instance out=w1)
  Build Array(w1) -> w2
  Random Number() -> (number (0 to 1)=w3)
  Multiply(w3, 8) -> w4
  Build Array(w4) -> w5
  # Create the Snake Head as first index
  Build Array("Snake Head.gtype" {all zero or empty}) -> w6
  Property Node(instance in="Entity.gtype" {all zero or empty}, "Snake Head"=w6, "Position"=w2, "Direction"=w5) -> (instance out=w7)
  Build Array[ConcatenateInputs=True](w7) -> w8
  Property Node(instance in="Game State.gtype" {all zero or empty}, "World Size:Width"=1000, "World Size:Height"=1000, "Entities"=w8) -> (instance out=w9)
  $"game state out" <- w9
